# Grasshopper definition glTF-Converter.ghx (Grasshopper 1.0.7)
# plug-ins: ShapeDiverForGrasshopper, GrasshopperHyperGooComponents

sddp = ShapeDiverDocumentPayload({AbsoluteTolerance=0, AngleTolerance=0, DistanceDisplayPrecision=0, GltfVersion="Gltf2", GrasshopperVersion="1.0.0007", InputGroups="{}", OutputGroups="{}", RelativeTolerance=0, RhinoVersion="7.37.24107.15001", UnitSystem=0, VersionCreated="1.20.0.0", VersionSaved="1.20.0.0"})
cadfileurl = DirectTextInput(maxlength=10000)
cadfile = ImportGeometry(
    URI=cadfileurl,
    maximum_file_size=52428800,
    selected_file_formats="application/3dm,application/3ds,application/ai,application/amf,application/dgn,application/dwg,application/dxf,application/fbx,application/off,application/pdf,application/ply,application/postscript,application/skp,application/sla,application/slc,application/step,application/vda,application/wavefront-obj,image/svg+xml,model/3mf,model/iges,model/stl")  # -> Object, Material, Filename
# Detach attributes, use
# material for glTF creation
deleteattr = DeleteAttributes(Object=cadfile.Object)
gltfdisplay = GlTF20Display(Geometry=deleteattr, Material=cadfile.Material)
